# Grasshopper definition GearTrainTest.gh (Grasshopper 1.0.7)
# plug-ins: Human UI

pt = ConstructPoint(XCoordinate=Slider(-10, range=-10..10), YCoordinate=Slider(-10, range=-10..10), ZCoordinate=Slider(90, range=0..100))
pt_2 = ConstructPoint(XCoordinate=Slider(40, range=0..100), YCoordinate=Slider(100, range=0..100), ZCoordinate=Slider(142, range=0..1000))
number_slider = Slider(100, range=0..100)
number_slider_2 = Slider(10, range=-10..10)
pt_3 = ConstructPoint(XCoordinate=Slider(70, range=0..100), YCoordinate=Slider(42, range=0..100), ZCoordinate=Slider(79, range=0..100))
pt_4 = ConstructPoint(XCoordinate=Slider(-10, range=-10..10), YCoordinate=Slider(-10, range=-10..10), ZCoordinate=Slider(40, range=0..100))
number_slider_3 = Slider(10, range=-10..10)
pt_5 = ConstructPoint(XCoordinate=Slider(-10, range=-10..10), YCoordinate=Slider(-10, range=-10..10), ZCoordinate=Slider(-10, range=-10..10))
pt_6 = ConstructPoint(XCoordinate=Slider(70, range=0..100), YCoordinate=Slider(42, range=0..100), ZCoordinate=Slider(22, range=0..100))
box = Box2Pt(PointA=pt, PointB=pt_2, Plane=PlaneXY(0, 0, 0))
box_2 = Box2Pt(PointA=pt_4, PointB=pt_3, Plane=PlaneXY(0, 0, 0))
box_3 = Box2Pt(PointA=pt_5, PointB=pt_6, Plane=PlaneXY(0, 0, 0))
number_slider_4 = Slider(8, range=0..10)
number_slider_5 = Slider(2, range=0..10)
number_slider_6 = Slider(1, range=0..100)
number_slider_7 = Slider(8, range=0..10)
number_slider_8 = Slider(2, range=0..10)
number_slider_9 = Slider(8, range=0..10)
Y = UnitY(Factor=1)
Z = UnitZ(Factor=1)
X = UnitX(Factor=1)
pt_7 = ConstructPoint(XCoordinate=Slider(5, range=-10..10), YCoordinate=Slider(7, range=-10..10), ZCoordinate=Slider(105, range=0..1000))
X_2 = UnitX(Factor=1)
pt_8 = ConstructPoint(XCoordinate=Slider(30, range=0..100), YCoordinate=Slider(87, range=0..100), ZCoordinate=Slider(120, range=0..1000))
number_slider_10 = Slider(1, range=0..1)
pt_9 = ConstructPoint(XCoordinate=Slider(5, range=-10..10), YCoordinate=Slider(5, range=-10..10), ZCoordinate=Slider(50, range=0..100))
pt_10 = ConstructPoint(XCoordinate=Slider(60, range=0..100), YCoordinate=Slider(30, range=0..100), ZCoordinate=Slider(50, range=0..100))
pt_11 = ConstructPoint(XCoordinate=Slider(5, range=-10..10), YCoordinate=Slider(-5, range=-10..10), ZCoordinate=Slider(2, range=-10..10))
pt_12 = ConstructPoint(XCoordinate=Slider(60, range=0..100), YCoordinate=Slider(10, range=-10..10), ZCoordinate=Slider(2, range=-10..10))
number_slider_11 = Slider(1, range=0..1)
number_slider_12 = Slider(1, range=0..1)
vec = VectorXYZ(XComponent=0, YComponent=Slider(1, range=0..1), ZComponent=Slider(0.2, range=0..1))  # -> Vector, Length
gt = GearTrain()
gt_2 = GearTrain(
    MainDirection=X,
    AxisDirection=vec.Vector,
    LastGearCenter=pt_12,
    InnerCavityBox=box_3,
    GearFaceWidth=Slider(2, range=0..10))
